# Grasshopper definition TimberSunScape.gh (Grasshopper 1.0.8)

longitude = GetInteger(Slider(5, range=1..10), AtLeast=1, AtMost=1, Maximum=2147483647, Minimum=-2147483648, TreeAccess=False)
latitude = GetNumber("40.676789", AtLeast=1, AtMost=1, Maximum=1.797693135e+308, Minimum=-1.797693135e+308, TreeAccess=False)
longitude_2 = GetNumber("-74.008487", AtLeast=1, AtMost=1, Maximum=1.797693135e+308, Minimum=-1.797693135e+308, TreeAccess=False)
py3 = Python3Script(latitude=latitude, longitude="-74.008487", walking_time=longitude)  # -> out, a, b, c, d, e, f, g, h; inputs latitude: Double, longitude: Double
# ---------- py3: Python ----------
# GHPython component for OpenStreetMap data with comprehensive urban features
import rhinoscriptsyntax as rs
import ghpythonlib.components as ghcomp
import Rhino.Geometry as rg
import json
import urllib.request
import math
# Add these imports at the top of your file
import itertools
from collections import defaultdict

class CoordinateTransformer:
    """
    Transforms WGS84 coordinates (lat/lon) to a local metric coordinate system
    """
    def __init__(self, origin_lat, origin_lon):
        self.origin_lat = origin_lat
        self.origin_lon = origin_lon
        # Earth radius in meters
        self.earth_radius = 6378137.0
        
        # Calculate conversion factors at the origin
        self.meters_per_lon = (math.pi/180) * self.earth_radius * math.cos(math.radians(origin_lat))
        self.meters_per_lat = (math.pi/180) * self.earth_radius
    
    def to_meters(self, lat, lon):
        """
        Convert lat/lon to meters from origin
        """
        dx = (lon - self.origin_lon) * self.meters_per_lon
        dy = (lat - self.origin_lat) * self.meters_per_lat
        return dx, dy
    
    def create_radius_curve(self, radius):
        """
        Create a circle representing the extraction radius
        """
        circle = rg.Circle(rg.Point3d(0, 0, 0), radius)
        return circle.ToNurbsCurve()

class OSMNode:
    def __init__(self, node_id, lon, lat, transformer, tags=None):
        self.id = node_id
        self.lon = lon
        self.lat = lat
        self.tags = tags or {}
        
        # Transform to local metric coordinates
        x, y = transformer.to_meters(lat, lon)
        self.point = rg.Point3d(x, y, 0)
        
        # Extract node properties
        self.properties = self.extract_properties()
        
    def extract_properties(self):
        """Extract useful properties from node tags"""
        props = {
            'id': self.id,
            'lon': self.lon,
            'lat': self.lat
        }
        
        # Add all tags as properties
        for key, value in self.tags.items():
            props[key] = value
            
        return props
        
    def __repr__(self):
        return f"Node({self.id}, {self.lon}, {self.lat})"

class OSMWay:
    def __init__(self, way_id, nodes, tags):
        self.id = way_id
        self.nodes = nodes  # List of OSMNode objects
        self.tags = tags    # Dictionary of tags
        self.curve = None   # Will store the Rhino curve
        self.properties = self.extract_properties()
        
    def extract_properties(self):
        """Extract useful properties from way tags"""
        props = {
            'id': self.id,
            'node_count': len(self.nodes)
        }
        
        # Add all tags as properties
        for key, value in self.tags.items():
            props[key] = value
            
        return props
        
    def create_curve(self):
        if len(self.nodes) < 2:
            print(f"Way {self.id}: Not enough nodes to create curve")
            return None
            
        points = [node.point for node in self.nodes]
        
        # Check if first and last points are the same for closure
        if len(points) > 2 and points[0].DistanceTo(points[-1]) < 0.0001:
            # Already closed
            polyline = rg.Polyline(points)
        else:
            # Make a copy of points and close it if it's a closed way
            closed_points = list(points)
            if len(closed_points) > 2 and self.should_be_closed():
                closed_points.append(closed_points[0])  # Close the polyline
            polyline = rg.Polyline(closed_points)
        
        self.curve = polyline.ToNurbsCurve()
        return self.curve
    
    def should_be_closed(self):
        """Determine if this way should be closed based on its tags"""
        # Buildings, landuse, water bodies, etc. should be closed
        for key in ['building', 'landuse', 'natural', 'waterway', 'leisure', 'amenity']:
            if key in self.tags:
                return True
        return False
        
    def __repr__(self):
        return f"Way({self.id}, nodes: {len(self.nodes)}, tags: {self.tags})"

class OSMBuilding(OSMWay):
    def __init__(self, way_id, nodes, tags):
        super().__init__(way_id, nodes, tags)
        self.geometry = None  # Will store the 3D geometry
        
        # Parse height information
        if 'height' in tags:
            try:
                self.height = float(tags['height'])
            except ValueError:
                self.height = 10  # Default
        else:
            self.height = 10  # Default height: 10m
        
        self.levels = int(tags.get('building:levels', 0))
        
        # Calculate height from levels if no height specified
        if 'height' not in tags and self.levels > 0:
            self.height = self.levels * 3  # Assume 3m per level
        
        # Additional properties
        self.building_type = tags.get('building', 'yes')
        self.name = tags.get('name', '')
        self.address = {
            'street': tags.get('addr:street', ''),
            'housenumber': tags.get('addr:housenumber', ''),
            'postcode': tags.get('addr:postcode', '')
        }
        
        # Update properties with building-specific data
        self.properties.update({
            'height': self.height,
            'levels': self.levels,
            'building_type': self.building_type,
            'name': self.name,
            'address': self.address
        })
    
    def create_geometry(self):
        # Make sure curve exists
        if self.curve is None:
            self.create_curve()
            
        if not self.curve or not self.curve.IsValid:
            print(f"Building {self.id}: Invalid curve")
            return None
            
        # Try different methods for extrusion
        try:
            # First create the planar surface
            # Make sure the curve is planar
            projected_curve = rg.Curve.ProjectToPlane(self.curve, rg.Plane.WorldXY)
            
            # Create a surface from the curve
            breps = rg.Brep.CreatePlanarBreps(projected_curve)
            
            if breps and len(breps) > 0:
                # Create extrusion using Grasshopper component
                extrusion = ghcomp.Extrude(breps[0], rg.Vector3d(0, 0, self.height))
                if extrusion:
                    self.geometry = extrusion
                    return self.geometry
            else:
                print(f"Building {self.id}: Failed to create planar brep")
                
        except Exception as e:
            print(f"Error creating geometry for building {self.id}: {str(e)}")
            
        return None
    
    def __repr__(self):
        return f"Building({self.id}, type: {self.building_type}, height: {self.height}m)"

class OSMStreet(OSMWay):
    def __init__(self, way_id, nodes, tags):
        super().__init__(way_id, nodes, tags)
        self.street_type = tags.get('highway', 'road')
        self.name = tags.get('name', '')
        self.width = float(tags.get('width', 5)) if 'width' in tags else 5  # Default width: 5m
        self.lanes = int(tags.get('lanes', 1)) if 'lanes' in tags else 1
        self.surface = tags.get('surface', '')
        self.oneway = tags.get('oneway', 'no') == 'yes'
        
        # Update properties with street-specific data
        self.properties.update({
            'street_type': self.street_type,
            'name': self.name,
            'width': self.width,
            'lanes': self.lanes,
            'surface': self.surface,
            'oneway': self.oneway
        })
    
    def __repr__(self):
        return f"Street({self.id}, name: {self.name}, type: {self.street_type})"

class OSMTree(OSMNode):
    def __init__(self, node_id, lon, lat, transformer, tags):
        super().__init__(node_id, lon, lat, transformer, tags)
        
        # Tree properties
        self.tree_type = tags.get('species', tags.get('genus', 'unknown'))
        self.height = float(tags.get('height', 5)) if 'height' in tags else 5  # Default height: 5m
        self.diameter = float(tags.get('diameter_crown', 3)) if 'diameter_crown' in tags else 3  # Default diameter: 3m
        
        # Update properties with tree-specific data
        self.properties.update({
            'tree_type': self.tree_type,
            'height': self.height,
            'diameter': self.diameter
        })
        
        # Tree geometry
        self.geometry = None
    
    def create_geometry(self):
        """Create 3D tree representation"""
        try:
            # Simple tree representation using primitive Rhino geometry
            trunk_radius = 0.2
            trunk_height = self.height * 0.7  # Trunk is 70% of total height
            crown_radius = self.diameter / 2
            
            # Create cylinder parameters directly
            base_point = self.point
            end_point = rg.Point3d(base_point.X, base_point.Y, base_point.Z + trunk_height)
            
            # Create trunk as cylindrical brep
            trunk_circle = rg.Circle(rg.Plane(base_point, rg.Vector3d.ZAxis), trunk_radius)
            trunk_path = rg.Line(base_point, end_point).ToNurbsCurve()
            trunk = rg.Brep.CreateFromSweep(trunk_circle.ToNurbsCurve(), trunk_path, True, 0.01)[0]
            
            # Create crown as sphere brep
            crown_center = rg.Point3d(base_point.X, base_point.Y, base_point.Z + trunk_height)
            crown = rg.Sphere(crown_center, crown_radius).ToBrep()
            
            # Return trunk and crown
            self.geometry = [trunk, crown]
            return self.geometry
            
        except Exception as e:
            print(f"Error creating tree geometry for {self.id}: {str(e)}")
            return None
    
    def __repr__(self):
        return f"Tree({self.id}, type: {self.tree_type}, height: {self.height}m)"

# Add this new class after OSMTree and before OSMDataManager
class OSMBlock:
    """Represents a city block defined by surrounding streets"""
    def __init__(self, block_id, boundary_curve, properties=None):
        self.id = block_id
        self.boundary = boundary_curve  # The curve outlining the block
        self.surface = None  # Will store the surface representation
        self.properties = properties or {}
    
    def create_surface(self):
        """Create a surface from the boundary curve"""
        if self.boundary and self.boundary.IsClosed:
            try:
                breps = rg.Brep.CreatePlanarBreps(self.boundary)
                if breps and len(breps) > 0:
                    self.surface = breps[0]
                    return self.surface
            except Exception as e:
                print(f"Error creating block surface: {str(e)}")
        return None
    
    def __repr__(self):
        return f"Block({self.id})"
    # In the OSMBlock class, add a method for color-coding
    def get_display_color(self):
        """Return a color based on block type"""
        if self.properties.get('type') == 'park':
            return rg.Color.FromArgb(120, 200, 120)  # Green for parks
        else:
            return rg.Color.FromArgb(200, 200, 200)  # Gray for urban blocks

class OSMDataManager:
    def __init__(self, origin_lat, origin_lon):
        self.nodes = {}  # Dictionary of OSMNode objects
        self.buildings = []  # List of OSMBuilding objects
        self.streets = []  # List of OSMStreet objects
        self.trees = []  # List of OSMTree objects
        self.other_ways = []  # List of other OSMWay objects
        self.transformer = CoordinateTransformer(origin_lat, origin_lon)
        
        # Store all available tags for metadata reporting
        self.all_node_tags = set()
        self.all_way_tags = set()
        
        # Extraction parameters
        self.display_radius = 0  # The radius we want to display/analyze
        self.query_radius = 0    # The radius we use for OSM query (larger to get complete blocks)
    
    def load_from_api(self, walking_minutes=10):
        """
        Fetch OSM data based on walking time (in minutes)
        """
        # Calculate radius based on walking time
        # Typical walking speed is about 5 km/h = 83.33 m/min
        walking_speed = 83.33  # meters per minute
        self.display_radius = walking_minutes * walking_speed
        
        # Use a larger radius for the query to ensure complete blocks
        # Adding 50% to account for street network and to avoid cutting off blocks
        self.query_radius = self.display_radius * 1.5
        
        lat = self.transformer.origin_lat
        lng = self.transformer.origin_lon
        
        print(f"{walking_time}-minute walking radius: {self.display_radius:.0f}m")
        print(f"Query radius (expanded): {self.query_radius:.0f}m")
        
        # Construct query for various urban features
        overpass_url = "https://overpass-api.de/api/interpreter"
        query = f"""
        [out:json];
        (
          way["building"](around:{self.query_radius},{lat},{lng});
          way["highway"](around:{self.query_radius},{lat},{lng});
          node["natural"="tree"](around:{self.query_radius},{lat},{lng});
          way["landuse"](around:{self.query_radius},{lat},{lng});
        );
        (._;>;);
        out body;
        """
        
        try:
            # Send request
            req = urllib.request.Request(
                overpass_url,
                data=query.encode('utf-8'),
                headers={'Content-Type': 'application/x-www-form-urlencoded'}
            )
            response = urllib.request.urlopen(req)
            data = json.loads(response.read().decode('utf-8'))
            
            # Process nodes first
            for element in data['elements']:
                if element['type'] == 'node':
                    tags = element.get('tags', {})
                    
                    # Record all tags for metadata
                    for tag in tags:
                        self.all_node_tags.add(tag)
                    
                    # Create specialized node types based on tags
                    if 'natural' in tags and tags['natural'] == 'tree':
                        tree = OSMTree(
                            element['id'], 
                            element['lon'], 
                            element['lat'],
                            self.transformer,
                            tags
                        )
                        self.trees.append(tree)
                    else:
                        node = OSMNode(
                            element['id'], 
                            element['lon'], 
                            element['lat'],
                            self.transformer,
                            tags
                        )
                        self.nodes[element['id']] = node
            
            print(f"Loaded {len(self.nodes)} nodes and {len(self.trees)} trees")
            
            # Process ways
            for element in data['elements']:
                if element['type'] == 'way':
                    # Get nodes for this way
                    way_nodes = []
                    for node_id in element['nodes']:
                        if node_id in self.nodes:
                            way_nodes.append(self.nodes[node_id])
                    
                    if len(way_nodes) < 2:  # Need at least 2 points for a valid curve
                        continue
                        
                    tags = element.get('tags', {})
                    
                    # Record all tags for metadata
                    for tag in tags:
                        self.all_way_tags.add(tag)
                    
                    # Classify way based on tags
                    if 'building' in tags:
                        building = OSMBuilding(element['id'], way_nodes, tags)
                        self.buildings.append(building)
                    elif 'highway' in tags:
                        street = OSMStreet(element['id'], way_nodes, tags)
                        self.streets.append(street)
                    else:
                        way = OSMWay(element['id'], way_nodes, tags)
                        self.other_ways.append(way)
            
            print(f"Loaded {len(self.buildings)} buildings, {len(self.streets)} streets, {len(self.other_ways)} other features")
            return True
            
        except Exception as e:
            print(f"Error loading OSM data: {str(e)}")
            return False
    
    def create_boundary_curve(self):
        """
        Create a circle representing the walking radius
        """
        return self.transformer.create_radius_curve(self.display_radius)
    
    def create_geometries(self):
        """
        Create all geometries
        """
        # Buildings - both curves and extrusions
        building_curves = []
        building_extrusions = []
        
        for building in self.buildings:
            # First create the curve for every building
            curve = building.create_curve()
            if curve:
                building_curves.append(curve)
            
            # Now try to create 3D geometry
            geometry = building.create_geometry()
            if geometry:
                building_extrusions.append(geometry)
        
        # Streets - using all streets without filtering
        street_curves = []
        for street in self.streets:
            curve = street.create_curve()
            if curve:
                street_curves.append(curve)
        
        # Trees
        tree_geometries = []
        for tree in self.trees:
            geometry = tree.create_geometry()
            if geometry:
                tree_geometries.extend(geometry)
        
        # Detect blocks
        self.detect_blocks()
        
        # Extract block curves and surfaces
        block_curves = []
        block_surfaces = []
        for block in self.blocks:
            if block.boundary:
                block_curves.append(block.boundary)
            if block.surface:
                block_surfaces.append(block.surface)
        
        # Create boundary curve
        boundary_curve = self.create_boundary_curve()
                
        return {
            'building_curves': building_curves,
            'building_extrusions': building_extrusions,
            'street_curves': street_curves,
            'tree_geometries': tree_geometries,
            'block_curves': block_curves,
            'block_surfaces': block_surfaces,
            'boundary_curve': boundary_curve
        }
    
    def get_all_properties(self):
        """
        Get all properties from all elements
        """
        properties = {
            'buildings': [building.properties for building in self.buildings],
            'streets': [street.properties for street in self.streets],
            'trees': [tree.properties for tree in self.trees],
            'metadata': {
                'node_tags': list(self.all_node_tags),
                'way_tags': list(self.all_way_tags),
                'walking_time_minutes': self.display_radius / 83.33,
                'walking_radius_meters': self.display_radius
            }
        }
        return properties
    
    def print_available_metadata(self):
        """
        Print all available OSM tags found in the data
        """
        print("\n--- AVAILABLE OSM METADATA ---")
        
        print("\nNode Tags:")
        for tag in sorted(self.all_node_tags):
            print(f"  - {tag}")
        
        print("\nWay Tags:")
        for tag in sorted(self.all_way_tags):
            print(f"  - {tag}")
        
        # Print some examples of actual values
        if self.buildings:
            print("\nExample Building Tags:")
            for key, value in self.buildings[0].tags.items():
                print(f"  - {key}: {value}")
        
        if self.streets:
            print("\nExample Street Tags:")
            for key, value in self.streets[0].tags.items():
                print(f"  - {key}: {value}")
        
        if self.trees:
            print("\nExample Tree Tags:")
            for key, value in self.trees[0].tags.items():
                print(f"  - {key}: {value}")
    def detect_blocks(self):
        """
        Detect urban blocks using simple 2D curve operations
        A more compatible approach for different Rhino versions
        """
        print("Detecting urban blocks from street network...")
        
        # Store the blocks
        self.blocks = []
        """
        
        try:
            # 1. Create a boundary curve
            boundary_circle = rg.Circle(rg.Point3d(0, 0, 0), self.display_radius)
            boundary_curve = boundary_circle.ToNurbsCurve()
            
            # 2. Create all street curves
            street_curves = []
            for street in self.streets:
                if street.curve is None:
                    street.create_curve()
                if street.curve:
                    street_curves.append(street.curve)
            
            if not street_curves:
                print("No streets available for block detection")
                return []
            
            # 3. Use the Region method to find enclosed areas
            # First, combine all curves (boundary + streets)
            all_curves = list(street_curves)
            all_curves.append(boundary_curve)
            
            # Create regions from curves
            regions = rg.Curve.CreateRegions(all_curves, rg.Plane.WorldXY, 0.01, 0.01)
            
            if not regions or len(regions) == 0:
                print("No regions found - try adjusting tolerance values")
                return []
            
            # 4. Process each region as a potential block
            block_count = 0
            for i, region_curves in enumerate(regions):
                # Each region might have multiple curves (outer loop + holes)
                if not region_curves or len(region_curves) == 0:
                    continue
                
                # Get the outer curve (should be the first one)
                region_curve = region_curves[0]
                
                # Calculate area - skip tiny fragments
                try:
                    area_props = rg.AreaMassProperties.Compute(region_curve)
                    if not area_props:
                        continue
                    area = area_props.Area
                    if area < 100:  # Skip very small areas
                        continue
                except:
                    continue
                
                # Find buildings within this block
                buildings_in_block = []
                for building in self.buildings:
                    if building.curve is None:
                        building.create_curve()
                    if not building.curve:
                        continue
                    
                    # Try to get building centroid
                    try:
                        building_props = rg.AreaMassProperties.Compute(building.curve)
                        if not building_props:
                            continue
                        building_centroid = building_props.Centroid
                        
                        # Check if centroid is inside region
                        containment = rg.Curve.Contains(
                            region_curve, 
                            building_centroid, 
                            rg.Plane.WorldXY, 
                            0.01
                        )
                        
                        if containment == rg.PointContainment.Inside:
                            buildings_in_block.append(building.id)
                    except:
                        continue
                
                # Only keep blocks that contain buildings or are large enough to be parks
                is_park = (area > 2000 and len(buildings_in_block) < 3)
                
                if len(buildings_in_block) > 0 or is_park:
                    # Create a block
                    block_type = "park" if is_park else "urban"
                    
                    block = OSMBlock(f"block_{i}", region_curve, {
                        'area': area,
                        'perimeter': region_curve.GetLength(),
                        'building_count': len(buildings_in_block),
                        'buildings': buildings_in_block,
                        'type': block_type
                    })
                    
                    # Create surface from the curve
                    try:
                        # Create a planar surface from the curve
                        breps = rg.Brep.CreatePlanarBreps(region_curve, 0.01)
                        if breps and len(breps) > 0:
                            block.surface = breps[0]
                    except:
                        pass  # It's okay if surface creation fails
                    
                    # Add to collection
                    self.blocks.append(block)
                    block_count += 1
            
            print(f"Detected {block_count} urban blocks from street network")
            return self.blocks
            
        except Exception as e:
            print(f"Error in block detection: {str(e)}")
            import traceback
            traceback.print_exc()
            return []
        """
        pass
# Grasshopper inputs 
latitude = 40.679117 
longitude = -74.013273
walking_time = 5  # minutes

# Create data manager with the origin at the specified coordinates
osm_data = OSMDataManager(latitude, longitude)
success = osm_data.load_from_api(walking_time)

from ghpythonlib.treehelpers import list_to_tree
if success:
    # Create geometries
    geometries = osm_data.create_geometries()
    
    # Get all properties
    properties = osm_data.get_all_properties()
    
    # Print available metadata
    osm_data.print_available_metadata()
    
    # Print statistics
    print(f"\n--- GEOMETRY STATISTICS ---")
    print(f"Building curves: {len(geometries['building_curves'])}")
    print(f"Building extrusions: {len(geometries['building_extrusions'])}")
    print(f"Street curves: {len(geometries['street_curves'])}")
    print(f"Tree geometries: {len(geometries['tree_geometries']) // 2} trees")  # Each tree has 2 parts
    print(f"Block curves: {len(geometries['block_curves'])}")
    print(f"Block surfaces: {len(geometries['block_surfaces'])}")
    
    # Output for Grasshopper - separate outputs as requested
    a = geometries['building_curves']      # Building curves
    b = geometries['building_extrusions']  # Building extrusions
    c = geometries['street_curves']        # Street curves 
    d = list_to_tree(properties['buildings'] )           # Building properties
    e = geometries['tree_geometries']      # Tree geometries
    f = geometries['boundary_curve']       # Walking radius boundary
    g = geometries['block_curves']         # Block curves (outlines)
    h = geometries['block_surfaces']       # Block surfaces
    i = properties                         # All properties and metadata
else:
    print("Failed to load OSM data")
    a = []  # Building curves
    b = []  # Building extrusions
    c = []  # Street curves
    d = []  # Building properties
    e = []  # Tree geometries
    f = None  # Boundary curve
    g = []  # Block curves
    h = []  # Block surfaces
    i = {}  # All properties
# ---------- end py3 ----------
panel = Panel(py3.d)
panel_2 = Panel(py3.out)
crv = Curve(py3.f)
boundary = BoundarySurfaces(Edges=crv)
crv_2 = Curve(py3.c)
crv_3 = Curve(py3.a)
brep = Brep(py3.b)
srfsplit = SurfaceSplit(Surface=boundary, Curves=crv_2)
area = Area(Geometry=crv_3)  # -> Area, Centroid
item = ListItem(List=crv_2, Index=0, Wrap=True)
colom = CollisionOneMany(Collider=area.Centroid, Obstacles=srfsplit)  # -> Collision, Index
py3_2 = Python3Script(numbers=colom.Index, surfaces=srfsplit)  # -> out, b, c; inputs numbers: list of Int32, surfaces: list of Surface
# ---------- py3_2: Python ----------
import Rhino.Geometry as rg
import ghpythonlib.components as ghcomp
from collections import defaultdict
from ghpythonlib.treehelpers import list_to_tree

def group_by_value(numbers):
    """
    Groups numbers by their values and returns a dictionary where:
    - Keys are the unique numbers from the input list
    - Values are lists of indices where each number appears
    
    Args:
        numbers: List of numbers
        
    Returns:
        Dictionary mapping each unique number to a list of indices
    """
    groups = defaultdict(list)
    
    # Iterate through the numbers and collect indices
    for i, num in enumerate(numbers):
        groups[num].append(i)
    
    return groups

# Input parameters from Grasshopper
# numbers = a  # List of numbers

# Group the numbers
grouped_indices = group_by_value(numbers)

# Prepare outputs for Grasshopper
# Get all unique values
all_unique_values = list(grouped_indices.keys())

# Filter out negative values
positive_unique_values = [val for val in all_unique_values if val >= 0]

# Get indices for positive values only
positive_indices = [grouped_indices[val] for val in positive_unique_values]

# Convert to data tree for Grasshopper output
indices_tree = list_to_tree(positive_indices)

# Output results
b = positive_unique_values  # Only positive values
c = indices_tree  # Data tree of indices for positive values only

# Optional: Print debugging information
print(f"Found {len(all_unique_values)} total unique values, {len(positive_unique_values)} positive values")
print(f"Original list has {len(numbers)} numbers")

print("Positive values and their indices:")
for val, indices in zip(positive_unique_values, positive_indices):
    print(f"Value {val} appears at indices: {indices}")
# ---------- end py3_2 ----------
cset = CreateSet(List=colom.Index)  # -> Set, Map
item_2 = ListItem(List=crv_3, Index=py3_2.c, Wrap=True)
item_3 = ListItem(List=brep, Index=py3_2.c, Wrap=True)
item_4 = ListItem(List=srfsplit, Index=py3_2.b, Wrap=True)
item_5 = ListItem(List=srfsplit, Index=cset.Set, Wrap=True)
area_2 = Area(Geometry=item_2)  # -> Area, Centroid
ma = MassAddition(Input=area_2.Area)  # -> Result, PartialResults
area_3 = Area(Geometry=item_4)  # -> graft(Area), Centroid
panel_3 = Panel(area_3.Area)
panel_4 = Panel(ma.Result)
number_slider = Slider(3, range=0..10)
tstat = TreeStatistics(Tree=item_2)  # -> Paths, Length, Count
item_6 = ListItem(List=tstat.Paths, Index=number_slider, Wrap=True)
division = Division(A=panel_4, B=panel_3)
item_7 = ListItem(List=srfsplit, Index=number_slider, Wrap=True)
branch = TreeBranch(Tree=item_2, Path=item_6, MaintainPaths=True)
panel_5 = Panel(division)
srf = Surface(graft(item_4))
num = Number(panel_5)
brep_2 = Brep(item_3)
crv_4 = Curve(item_2)
context_print = ContextPrint(AreaRatioByBlock=num)
context_bake = ContextBake(Building_Curves=crv_4)
context_bake_2 = ContextBake(Buildings=brep_2)
context_bake_3 = ContextBake(Geometry=srf)
